# Grasshopper definition Animated Floorplans (1).gh (Grasshopper 1.0.8)

groundfloor = Geometry([<curve referenced from the Rhino model>, <instancereference referenced from the Rhino model>, <point referenced from the Rhino model> x2, <instancereference referenced from the Rhino model>, <point referenced from the Rhino model> x13, <curve referenced from the Rhino model> x4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])
groundfloor_2 = Geometry([<curve referenced from the Rhino model>, <instancereference referenced from the Rhino model>, <point referenced from the Rhino model> x2, <instancereference referenced from the Rhino model>, <point referenced from the Rhino model> x13, <curve referenced from the Rhino model> x4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])
groundfloor_3 = Geometry([<curve referenced from the Rhino model> x8, <instancereference referenced from the Rhino model>, <point referenced from the Rhino model>, <instancereference referenced from the Rhino model>, <point referenced from the Rhino model> x2, <instancereference referenced from the Rhino model>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])
firstfloor = Geometry([<curve referenced from the Rhino model>, <instancereference referenced from the Rhino model>, <point referenced from the Rhino model>, <curve referenced from the Rhino model> x2, <point referenced from the Rhino model>, <curve referenced from the Rhino model> x3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])
firstfloor_2 = Geometry([<instancereference referenced from the Rhino model>, <point referenced from the Rhino model> x3, <curve referenced from the Rhino model>, <instancereference referenced from the Rhino model>, <point referenced from the Rhino model> x5, <instancereference referenced from the Rhino model>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])
firstfloor_3 = Geometry([<curve referenced from the Rhino model> x3, <instancereference referenced from the Rhino model>, <point referenced from the Rhino model>, <curve referenced from the Rhino model>, <instancereference referenced from the Rhino model>, <point referenced from the Rhino model>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])
groundfloor_4 = Geometry([<curve referenced from the Rhino model>, <instancereference referenced from the Rhino model>, <point referenced from the Rhino model>, <instancereference referenced from the Rhino model>, <curve referenced from the Rhino model>, <point referenced from the Rhino model> x32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])
firstfloor_4 = Geometry([<curve referenced from the Rhino model> x2, <instancereference referenced from the Rhino model>, <point referenced from the Rhino model>, <instancereference referenced from the Rhino model>, <curve referenced from the Rhino model> x2, <point referenced from the Rhino model> x17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])
groundfloor_5 = Geometry([<point referenced from the Rhino model> x9, <curve referenced from the Rhino model> x3, <instancereference referenced from the Rhino model> x5, <point referenced from the Rhino model> x10, <curve referenced from the Rhino model> x2, <point referenced from the Rhino model> x10, <curve referenced from the Rhino model> x4, <point referenced from the Rhino model> x4, <curve referenced from the Rhino model> x14, <point referenced from the Rhino model>, <instancereference referenced from the Rhino model>, <point referenced from the Rhino model> x3, <instancereference referenced from the Rhino model>, <point referenced from the Rhino model> x2, <curve referenced from the Rhino model>, <point referenced from the Rhino model> x2])
firstfloor_5 = Geometry([<curve referenced from the Rhino model> x3, <instancereference referenced from the Rhino model>, <curve referenced from the Rhino model> x2, <point referenced from the Rhino model> x2, <instancereference referenced from the Rhino model>, <point referenced from the Rhino model> x36, <curve referenced from the Rhino model> x5, <instancereference referenced from the Rhino model>, <curve referenced from the Rhino model> x2, <instancereference referenced from the Rhino model>, <curve referenced from the Rhino model> x2, <instancereference referenced from the Rhino model>, <curve referenced from the Rhino model> x7, <point referenced from the Rhino model>, <instancereference referenced from the Rhino model>])
cluster = Cluster(T=firstfloor)  # -> flatten(A), flatten(P), flatten(G)
cluster_2 = Cluster(T=firstfloor_2)  # -> flatten(A), flatten(P), flatten(G)
cluster_3 = Cluster(T=firstfloor_3)  # -> flatten(A), flatten(P), flatten(G)
cluster_4 = Cluster(T=groundfloor)  # -> flatten(A), flatten(P), flatten(G)
cluster_5 = Cluster(T=groundfloor_2)  # -> flatten(A), flatten(P), flatten(G)
cluster_6 = Cluster(T=firstfloor_4)  # -> flatten(A), flatten(P), flatten(G)
cluster_7 = Cluster(T=groundfloor_3)  # -> flatten(A), flatten(P), flatten(G)
cluster_8 = Cluster(T=groundfloor_4)  # -> flatten(A), flatten(P), flatten(G)
cluster_9 = Cluster(T=firstfloor_5)  # -> flatten(A), flatten(P), flatten(G)
cluster_10 = Cluster(T=groundfloor_5)  # -> flatten(A), flatten(P), flatten(G)
dom = ConstructDomain(DomainStart=Slider(6000, range=0..10000), DomainEnd=Slider(6599, range=0..10000))
dom_2 = ConstructDomain(DomainStart=Slider(6600, range=0..10000), DomainEnd=Slider(7300, range=0..10000))
dom_3 = ConstructDomain(DomainStart=Slider(4800, range=0..10000), DomainEnd=Slider(5999, range=0..10000))
dom_4 = ConstructDomain(DomainStart=Slider(4200, range=0..10000), DomainEnd=Slider(4799, range=0..10000))
dom_5 = ConstructDomain(DomainStart=Slider(3600, range=0..10000), DomainEnd=Slider(4199, range=0..10000))
c_script = CSharpScript(layers=cluster.A, namen=cluster.P, geometrie=cluster.G, range=dom, floor=Slider(1, range=0..100))  # -> json; inputs layers: list of String, namen: list of String, geometrie: list of GeometryBase, range: Interval, floor: Int32
# ---------- c_script: C# ----------
// Grasshopper Script Instance
#region Usings
using System;
using System.Linq;
using System.Collections;
using System.Collections.Generic;
using System.Drawing;

using Rhino;
using Rhino.Geometry;

using Grasshopper;
using Grasshopper.Kernel;
using Grasshopper.Kernel.Data;
using Grasshopper.Kernel.Types;
#endregion

public class Script_Instance : GH_ScriptInstance
{
private void RunScript(
		List<string> layers,
		List<string> namen,
		List<GeometryBase> geometrie,
		Interval range,
		int floor,
		ref object json)
{
    int n = geometrie.Count;
    const double EPS = 0.01;
    var ci = System.Globalization.CultureInfo.InvariantCulture;

    // ---------- helpers ----------
    Func<GeometryBase, Polyline> tryPoly = (g) => {
        if (g == null) return null;
        var c = g as Curve; if (c == null) return null;
        Polyline pl; if (c.TryGetPolyline(out pl)) return pl;
        return null;
    };
    Func<GeometryBase, Point3d?> tryPt = (g) => {
        var p = g as Rhino.Geometry.Point;
        if (p != null) return p.Location;
        return null;
    };
    Func<double, string> fmt = (d) => {
        double r = Math.Round(d, 2);
        if (r == 0.0) r = 0.0;
        return r.ToString("0.##", ci);
    };
    Func<string, string> esc = (s) => (s ?? "").Replace("\\", "\\\\").Replace("\"", "\\\"");

    Func<List<Point3d>, double> signedArea2 = (pts) => {
        double a = 0.0; int m = pts.Count;
        for (int i = 0; i < m; i++) {
            var p = pts[i]; var q = pts[(i + 1) % m];
            a += p.X * q.Y - q.X * p.Y;
        }
        return a;
    };
    Func<Polyline, List<Point3d>> toCCW = (poly) => {
        int count = poly.Count;
        if (count > 1 && poly[0].DistanceTo(poly[count - 1]) < EPS) count--;
        var pts = new List<Point3d>();
        for (int j = 0; j < count; j++) pts.Add(poly[j]);
        if (signedArea2(pts) < 0) pts.Reverse();
        return pts;
    };
    Func<Polyline, List<Point3d>> toOrdered = (poly) => {
        int count = poly.Count;
        if (count > 1 && poly[0].DistanceTo(poly[count - 1]) < EPS) count--;
        var pts = new List<Point3d>();
        for (int j = 0; j < count; j++) pts.Add(poly[j]);
        return pts;
    };
    Func<Vector3d, int> snapQuad = (v) => {
        double a = Math.Atan2(v.Y, v.X) * 180.0 / Math.PI;
        return ((int)Math.Round(a / 90.0) % 4 + 4) % 4;
    };

    // ---------- 1. classify by layer ----------
    var allPTs = new List<(string corner, Point3d pt)>();
    var roomItems   = new List<(string name, Polyline poly)>();
    var wallItems   = new List<Polyline>();
    var windowItems = new List<Polyline>();
    var furnItems   = new List<(string name, Polyline poly)>();
    var doorItems   = new List<Polyline>();

    for (int i = 0; i < n; i++) {
        string layer = (i < layers.Count ? layers[i] : "") ?? "";
        string nm    = (i < namen.Count  ? namen[i]  : "") ?? "";
        var geo = geometrie[i];
        string l = layer.ToLowerInvariant();

        if      (l.Contains("pt linksonder"))  { var p = tryPt(geo); if (p.HasValue) allPTs.Add(("LO", p.Value)); }
        else if (l.Contains("pt linksboven"))  { var p = tryPt(geo); if (p.HasValue) allPTs.Add(("LB", p.Value)); }
        else if (l.Contains("pt rechtsboven")) { var p = tryPt(geo); if (p.HasValue) allPTs.Add(("RB", p.Value)); }
        else if (l.Contains("pt rechtsonder")) { var p = tryPt(geo); if (p.HasValue) allPTs.Add(("RO", p.Value)); }
        else if (l.Contains("rooms"))     { var pl = tryPoly(geo); if (pl != null) roomItems.Add((nm, pl)); }
        else if (l.Contains("walls"))     { var pl = tryPoly(geo); if (pl != null) wallItems.Add(pl); }
        else if (l.Contains("windows"))   { var pl = tryPoly(geo); if (pl != null) windowItems.Add(pl); }
        else if (l.Contains("furniture")) { var pl = tryPoly(geo); if (pl != null) furnItems.Add((nm, pl)); }
        else if (l.Contains("doors"))     { var pl = tryPoly(geo); if (pl != null) doorItems.Add(pl); }
    }

    // ---------- 2. building corners (hardcoded) ----------
    double rMin = range.T0, rMax = range.T1;
    if (rMin > rMax) { double t = rMin; rMin = rMax; rMax = t; }
    const double DIEPTE_REF = 9560.0;
    double rangeRef = rMin;

    var refCorners = new Dictionary<string, Point3d>() {
        { "LO", new Point3d(0,          0,        0) },
        { "LB", new Point3d(0,          rangeRef, 0) },
        { "RB", new Point3d(DIEPTE_REF, rangeRef, 0) },
        { "RO", new Point3d(DIEPTE_REF, 0,        0) }
    };

    // ---------- 3. resolver ----------
    // Pak de PT die het dichtst bij het gegeven punt ligt; corner = layer van die PT.
    Func<Point3d, (string corner, double dx, double dy)> resolveByPT = (v) => {
        string bestCorner = "LO";
        double bestDist = double.MaxValue;
        if (allPTs.Count > 0) {
            foreach (var pt in allPTs) {
                double d = pt.pt.DistanceTo(v);
                if (d < bestDist) { bestDist = d; bestCorner = pt.corner; }
            }
        } else {
            foreach (var kv in refCorners) {
                double d = kv.Value.DistanceTo(v);
                if (d < bestDist) { bestDist = d; bestCorner = kv.Key; }
            }
        }
        var c = refCorners[bestCorner];
        return (bestCorner, v.X - c.X, v.Y - c.Y);
    };

    // ---------- 4. JSON ----------
    string floorName =
        (floor == 0) ? "begane_grond" :
        (floor == 1) ? "1e_verdieping" :
        (floor == 2) ? "zolder" : "";

    var sb = new System.Text.StringBuilder();
    sb.Append("{\n");
    sb.Append("  \"meta\": {\n");
    sb.Append("    \"floor\": \"" + floorName + "\",\n");
    sb.Append("    \"rangeMin\": " + fmt(rMin) + ",\n");
    sb.Append("    \"rangeMax\": " + fmt(rMax) + ",\n");
    sb.Append("    \"referenceRange\": " + fmt(rangeRef) + ",\n");
    sb.Append("    \"referenceDiepte\": " + fmt(DIEPTE_REF) + "\n");
    sb.Append("  },\n");

    // rooms
    sb.Append("  \"rooms\": [\n");
    for (int ri = 0; ri < roomItems.Count; ri++) {
        var item = roomItems[ri];
        var pts = toCCW(item.poly);
        sb.Append("    {\n");
        sb.Append("      \"name\": \"" + esc(item.name) + "\",\n");
        sb.Append("      \"vertices\": [\n");
        for (int j = 0; j < pts.Count; j++) {
            var rv = resolveByPT(pts[j]);
            sb.Append("        { \"corner\": \"" + rv.corner + "\", \"dx\": " + fmt(rv.dx) + ", \"dy\": " + fmt(rv.dy) + " }");
            sb.Append(j < pts.Count - 1 ? ",\n" : "\n");
        }
        sb.Append("      ]\n    }");
        sb.Append(ri < roomItems.Count - 1 ? ",\n" : "\n");
    }
    sb.Append("  ],\n");

    // walls + windows
    Action<string, List<Polyline>> writePolys = (key, list) => {
        sb.Append("  \"" + key + "\": [\n");
        for (int wi = 0; wi < list.Count; wi++) {
            var pts = toCCW(list[wi]);
            sb.Append("    {\n      \"vertices\": [\n");
            for (int j = 0; j < pts.Count; j++) {
                var rv = resolveByPT(pts[j]);
                sb.Append("        { \"corner\": \"" + rv.corner + "\", \"dx\": " + fmt(rv.dx) + ", \"dy\": " + fmt(rv.dy) + " }");
                sb.Append(j < pts.Count - 1 ? ",\n" : "\n");
            }
            sb.Append("      ]\n    }");
            sb.Append(wi < list.Count - 1 ? ",\n" : "\n");
        }
        sb.Append("  ],\n");
    };
    writePolys("walls", wallItems);
    writePolys("windows", windowItems);

// furniture — gesplitst: standaard meubels via center-PT, flexibele meubels via vertex-PTs
// Een meubel is flexibel als de naam (zonder rotatie-suffix) begint met "Flexible" of "Flexibel"
var furnStandard = new List<(string name, Polyline poly)>();
var furnFlex     = new List<(string name, Polyline poly)>();
foreach (var fi in furnItems) {
    string nm = (fi.name ?? "").Trim();
    // strip rotatie-suffix " (90)" etc voor de check
    string nameForCheck = nm;
    int op0 = nameForCheck.LastIndexOf('(');
    if (op0 > 0) nameForCheck = nameForCheck.Substring(0, op0).Trim();

    bool isFlex =
        nameForCheck.StartsWith("Flexible", StringComparison.OrdinalIgnoreCase) ||
        nameForCheck.StartsWith("Flexibel", StringComparison.OrdinalIgnoreCase);

    if (isFlex) furnFlex.Add((nm, fi.poly));
    else        furnStandard.Add((nm, fi.poly));
}
sb.Append("  \"furniture\": [\n");
for (int fi = 0; fi < furnStandard.Count; fi++) {
    var fname = furnStandard[fi].name;
    var poly  = furnStandard[fi].poly;
    string type = (fname ?? "").Trim();
    int rotation = 0;
    int op = type.LastIndexOf('(');
    int cp = type.LastIndexOf(')');
    if (op >= 0 && cp > op) {
        string rs = type.Substring(op + 1, cp - op - 1).Trim();
        int rot;
        if (int.TryParse(rs, out rot)) {
            rotation = ((rot % 360) + 360) % 360;
            type = type.Substring(0, op).Trim();
        }
    }
    var bb = poly.BoundingBox;
    var center = new Point3d((bb.Min.X + bb.Max.X) * 0.5, (bb.Min.Y + bb.Max.Y) * 0.5, 0);
    double w = bb.Max.X - bb.Min.X;
    double h = bb.Max.Y - bb.Min.Y;
    var rv = resolveByPT(center);
    sb.Append("    {\n");
    sb.Append("      \"type\": \"" + esc(type) + "\",\n");
    sb.Append("      \"rotation\": " + rotation + ",\n");
    sb.Append("      \"corner\": \"" + rv.corner + "\",\n");
    sb.Append("      \"dx\": " + fmt(rv.dx) + ",\n");
    sb.Append("      \"dy\": " + fmt(rv.dy) + ",\n");
    sb.Append("      \"size\": { \"w\": " + fmt(w) + ", \"h\": " + fmt(h) + " }\n");
    sb.Append("    }");
    sb.Append(fi < furnStandard.Count - 1 ? ",\n" : "\n");
}
sb.Append("  ],\n");

// furnitureFlex — polygon-based, vertex-PT-anchored (zelfde patroon als rooms/walls)
sb.Append("  \"furnitureFlex\": [\n");
for (int fi = 0; fi < furnFlex.Count; fi++) {
    var fname = furnFlex[fi].name;
    var poly  = furnFlex[fi].poly;
    string type = (fname ?? "").Trim();
    int rotation = 0;
    int op = type.LastIndexOf('(');
    int cp = type.LastIndexOf(')');
    if (op >= 0 && cp > op) {
        string rs = type.Substring(op + 1, cp - op - 1).Trim();
        int rot;
        if (int.TryParse(rs, out rot)) {
            rotation = ((rot % 360) + 360) % 360;
            type = type.Substring(0, op).Trim();
        }
    }
    var pts = toCCW(poly);
    sb.Append("    {\n");
    sb.Append("      \"type\": \"" + esc(type) + "\",\n");
    sb.Append("      \"rotation\": " + rotation + ",\n");
    sb.Append("      \"vertices\": [\n");
    for (int j = 0; j < pts.Count; j++) {
        var rv = resolveByPT(pts[j]);
        sb.Append("        { \"corner\": \"" + rv.corner + "\", \"dx\": " + fmt(rv.dx) + ", \"dy\": " + fmt(rv.dy) + " }");
        sb.Append(j < pts.Count - 1 ? ",\n" : "\n");
    }
    sb.Append("      ]\n    }");
    sb.Append(fi < furnFlex.Count - 1 ? ",\n" : "\n");
}
sb.Append("  ],\n");

    // doors
    // Input polyline = V1 - V2 - V3 (3 vertices). V2 is een offset-punt buiten de wand,
    // met een PT eronder; de layer van die PT bepaalt de corner.
    // V1 en V3 zijn de twee uiteinden van de gesloten deur (op de wand).
    // V3 = scharnier (dichtst bij V2), V1 = ander uiteinde.
    var doorEntries = new List<(int type, string corner, double dx1, double dy1, double dx2, double dy2)>();
    foreach (var pl in doorItems) {
        var pts = toOrdered(pl);
        if (pts.Count < 3) continue;
        Point3d vA = pts[0];
        Point3d vB = pts[1];   // V2 = offset point op een PT
        Point3d vC = pts[2];
        double dAB = vA.DistanceTo(vB);
        double dCB = vC.DistanceTo(vB);
        if (dAB < EPS || dCB < EPS) continue;

        Point3d v3, v1;
        if (dAB <= dCB) { v3 = vA; v1 = vC; }
        else            { v3 = vC; v1 = vA; }

        Vector3d wallDir   = v1 - v3;
        Vector3d offsetDir = vB - v3;
        if (wallDir.Length < EPS) continue;

        int wDir = snapQuad(wallDir);
        double cross = wallDir.X * offsetDir.Y - wallDir.Y * offsetDir.X;
        int swingSide = (cross >= 0) ? 0 : 1;
        int doorType = wDir + swingSide * 4;

        // corner via PT op V2
        var rv = resolveByPT(vB);
        var c = refCorners[rv.corner];
        double dx1 = v3.X - c.X;
        double dy1 = v3.Y - c.Y;
        double dx2 = v1.X - c.X;
        double dy2 = v1.Y - c.Y;

        doorEntries.Add((doorType, rv.corner, dx1, dy1, dx2, dy2));
    }

    sb.Append("  \"doors\": [\n");
    for (int di = 0; di < doorEntries.Count; di++) {
        var e = doorEntries[di];
        sb.Append("    {\n");
        sb.Append("      \"type\": " + e.type + ",\n");
        sb.Append("      \"corner\": \"" + e.corner + "\",\n");
        sb.Append("      \"dx1\": " + fmt(e.dx1) + ",\n");
        sb.Append("      \"dy1\": " + fmt(e.dy1) + ",\n");
        sb.Append("      \"dx2\": " + fmt(e.dx2) + ",\n");
        sb.Append("      \"dy2\": " + fmt(e.dy2) + "\n");
        sb.Append("    }");
        sb.Append(di < doorEntries.Count - 1 ? ",\n" : "\n");
    }
    sb.Append("  ]\n}\n");

    json = sb.ToString();
}

}
# ---------- end c_script ----------
c_script_2 = CSharpScript(layers=cluster_2.A, namen=cluster_2.P, geometrie=cluster_2.G, range=dom_2, floor=Slider(1, range=0..100))  # -> json; inputs layers: list of String, namen: list of String, geometrie: list of GeometryBase, range: Interval, floor: Int32; same code as c_script
c_script_3 = CSharpScript(layers=cluster_3.A, namen=cluster_3.P, geometrie=cluster_3.G, range=dom_3, floor=Slider(1, range=0..100))  # -> json; inputs layers: list of String, namen: list of String, geometrie: list of GeometryBase, range: Interval, floor: Int32; same code as c_script
c_script_4 = CSharpScript(layers=cluster_4.A, namen=cluster_4.P, geometrie=cluster_4.G, range=dom, floor=Slider(0, range=0..100))  # -> json; inputs layers: list of String, namen: list of String, geometrie: list of GeometryBase, range: Interval, floor: Int32; same code as c_script
c_script_5 = CSharpScript(layers=cluster_5.A, namen=cluster_5.P, geometrie=cluster_5.G, range=dom_2, floor=Slider(0, range=0..100))  # -> json; inputs layers: list of String, namen: list of String, geometrie: list of GeometryBase, range: Interval, floor: Int32; same code as c_script
c_script_6 = CSharpScript(layers=cluster_7.A, namen=cluster_7.P, geometrie=cluster_7.G, range=dom_3, floor=Slider(0, range=0..100))  # -> json; inputs layers: list of String, namen: list of String, geometrie: list of GeometryBase, range: Interval, floor: Int32; same code as c_script
c_script_7 = CSharpScript(layers=cluster_6.A, namen=cluster_6.P, geometrie=cluster_6.G, range=dom_4, floor=Slider(1, range=0..100))  # -> json; inputs layers: list of String, namen: list of String, geometrie: list of GeometryBase, range: Interval, floor: Int32; same code as c_script
c_script_8 = CSharpScript(layers=cluster_8.A, namen=cluster_8.P, geometrie=cluster_8.G, range=dom_4, floor=Slider(0, range=0..100))  # -> json; inputs layers: list of String, namen: list of String, geometrie: list of GeometryBase, range: Interval, floor: Int32; same code as c_script
c_script_9 = CSharpScript(layers=cluster_9.A, namen=cluster_9.P, geometrie=cluster_9.G, range=dom_5, floor=Slider(1, range=0..100))  # -> json; inputs layers: list of String, namen: list of String, geometrie: list of GeometryBase, range: Interval, floor: Int32; same code as c_script
c_script_10 = CSharpScript(layers=cluster_10.A, namen=cluster_10.P, geometrie=cluster_10.G, range=dom_5, floor=Slider(0, range=0..100))  # -> json; inputs layers: list of String, namen: list of String, geometrie: list of GeometryBase, range: Interval, floor: Int32; same code as c_script
merge = Merge(
    Data1=c_script_10,
    Data2=c_script_9,
    Data3=c_script_8,
    Data4=c_script_7,
    Data5=c_script_6,
    Data6=c_script_3,
    Data7=c_script_4,
    Data8=c_script,
    Data9=c_script_5,
    Data10=c_script_2)
c_script_11 = CSharpScript(
    jsonText=merge,
    diepte=Slider(12000, range=0..12000),
    range=Slider(5469, range=3600..7300),
    floor=Slider(1, range=0..10),
    kopDwarsMin=Toggle(False),
    kopDwarsMax=Toggle(False))  # -> wanden, kozijnen, zones, binnenwanden, deurbladen, deurbogen, kamers, maatlijnen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; inputs jsonText: String, diepte: Double, range: Double, floor: Int32, kopDwarsMin: Boolean, kopDwarsMax: Boolean
# ---------- c_script_11: C# ----------
// Grasshopper Script Instance
#region Usings
#r "nuget: Newtonsoft.Json"
using System;
using System.Linq;
using System.Collections;
using System.Collections.Generic;
using System.Drawing;
using Newtonsoft.Json.Linq;


using Rhino;
using Rhino.Geometry;

using Grasshopper;
using Grasshopper.Kernel;
using Grasshopper.Kernel.Data;
using Grasshopper.Kernel.Types;
#endregion

public class Script_Instance : GH_ScriptInstance
{
private void RunScript(
		string jsonText,
		double diepte,
		double range,
		int floor,
		bool kopDwarsMin,
		bool kopDwarsMax,
		ref object wanden,
		ref object kozijnen,
		ref object zones,
		ref object binnenwanden,
		ref object deurbladen,
		ref object deurbogen,
		ref object kamers,
		ref object maatlijnen,
		ref object beuklijnen,
		ref object meubelpunten,
		ref object meubelnamen,
		ref object meubelvlakken)
{
    const double KOPGEVEL_OFFSET = 320.0;
    const double ZONE1           = 3210.0;
    const double ZONE2           = 6350.0;
    const double ZONE3_MAX       = 4000.0;
    const double OFF1            = 200.0;
    const double OFF2            = 400.0;
    const double OVERSTEEK       = 100.0;
    const double EPS             = 0.01;

    var wandList    = new List<Polyline>();
    var kozijnList  = new List<Polyline>();
    var binnenList  = new List<Polyline>();
    var bladList    = new List<Line>();
    var boogList    = new List<Arc>();
    var kamerList   = new List<Polyline>();
    var zoneList    = new List<Line>();
    var maatList    = new List<Line>();
    var beukList    = new List<Line>();
    var meubelPts   = new List<Point3d>();
    var meubelNames = new List<string>();
    var meubelFlex  = new List<Polyline>();

    var corners = new Dictionary<string, Point3d> {
        { "LO", new Point3d(0,      0,     0) },
        { "LB", new Point3d(0,      range, 0) },
        { "RB", new Point3d(diepte, range, 0) },
        { "RO", new Point3d(diepte, 0,     0) }
    };

    Func<JToken, Point3d> resolve = (v) => {
        var c = corners[(string)v["corner"]];
        return new Point3d(c.X + (double)v["dx"], c.Y + (double)v["dy"], 0);
    };

    Func<JToken, List<Point3d>> readVerts = (item) => {
        var pts = new List<Point3d>();
        foreach (var v in item["vertices"]) pts.Add(resolve(v));
        pts.Add(pts[0]);
        return pts;
    };

    Func<double, double, double, double, Polyline> rect = (x1, y1, x2, y2) =>
        new Polyline(new[] {
            new Point3d(x1, y1, 0), new Point3d(x2, y1, 0),
            new Point3d(x2, y2, 0), new Point3d(x1, y2, 0),
            new Point3d(x1, y1, 0)
        });

    var doorOpenings = new List<Tuple<Point3d, Point3d>>();

    // ============ JSON: kies juiste plattegrond ============
    string targetFloor =
        (floor == 0) ? "begane_grond" :
        (floor == 1) ? "1e_verdieping" :
        (floor == 2) ? "zolder" : "";

    JObject root = null;
    if (!string.IsNullOrEmpty(jsonText)) {
        // Wrap meerdere objecten achter elkaar als array, ongeacht of jsonText
        // een enkel object, een array, of een sequentie van objecten is.
        string trimmed = jsonText.Trim();
        JArray docs;
        if (trimmed.StartsWith("[")) {
            docs = JArray.Parse(trimmed);
        } else {
            // Vervang "}{" of "}\n{" door "},{" en wrap in []
            string normalized = System.Text.RegularExpressions.Regex
                .Replace(trimmed, @"\}\s*\{", "},{");
            docs = JArray.Parse("[" + normalized + "]");
        }

        foreach (var doc in docs) {
            var meta = doc["meta"];
            if (meta == null) continue;
            string f = (string)meta["floor"];
            double rMin = (double)meta["rangeMin"];
            double rMax = (double)meta["rangeMax"];
            if (f == targetFloor && range >= rMin - EPS && range <= rMax + EPS) {
                root = (JObject)doc;
                break;
            }
        }
    }

    // ============ Tekenen vanuit gekozen JSON ============
    if (root != null) {
        foreach (var r in root["rooms"])   kamerList.Add(new Polyline(readVerts(r)));
        foreach (var k in root["windows"]) kozijnList.Add(new Polyline(readVerts(k)));

        foreach (var d in root["doors"]) {
            int type = (int)d["type"];
            var c = corners[(string)d["corner"]];
            var hinge  = new Point3d(c.X + (double)d["dx2"], c.Y + (double)d["dy2"], 0);
            var closed = new Point3d(c.X + (double)d["dx1"], c.Y + (double)d["dy1"], 0);

            doorOpenings.Add(Tuple.Create(hinge, closed));

            double r = hinge.DistanceTo(closed);
            double aClosed = Math.Atan2(closed.Y - hinge.Y, closed.X - hinge.X);
            double sign = (type < 4) ? -1.0 : 1.0;
            double a30  = aClosed + sign * (Math.PI / 6.0);

            boogList.Add(new Arc(
                new Circle(new Plane(hinge, Vector3d.ZAxis), r),
                new Interval(aClosed, a30)));
            bladList.Add(new Line(
                hinge,
                new Point3d(hinge.X + r * Math.Cos(a30),
                            hinge.Y + r * Math.Sin(a30), 0)));
        }

        foreach (var w in root["walls"]) {
            var wall = new Polyline(readVerts(w));
            bool wasCut = false;

            if (wall.Count == 5) {
                bool axisAligned = true;
                for (int i = 0; i < 4; i++) {
                    if (Math.Abs(wall[i].X - wall[i + 1].X) > EPS &&
                        Math.Abs(wall[i].Y - wall[i + 1].Y) > EPS) {
                        axisAligned = false; break;
                    }
                }

                if (axisAligned) {
                    var bb = wall.BoundingBox;
                    double minX = bb.Min.X, maxX = bb.Max.X;
                    double minY = bb.Min.Y, maxY = bb.Max.Y;
                    double wW = maxX - minX, wH = maxY - minY;

                    foreach (var op in doorOpenings) {
                        var hinge = op.Item1; var closed = op.Item2;
                        if (hinge.X  < minX - EPS || hinge.X  > maxX + EPS) continue;
                        if (hinge.Y  < minY - EPS || hinge.Y  > maxY + EPS) continue;
                        if (closed.X < minX - EPS || closed.X > maxX + EPS) continue;
                        if (closed.Y < minY - EPS || closed.Y > maxY + EPS) continue;

                        if (wW > wH) {
                            double x1 = Math.Min(hinge.X, closed.X);
                            double x2 = Math.Max(hinge.X, closed.X);
                            if (x1 - minX > EPS) wandList.Add(rect(minX, minY, x1,   maxY));
                            if (maxX - x2 > EPS) wandList.Add(rect(x2,   minY, maxX, maxY));
                        } else {
                            double y1 = Math.Min(hinge.Y, closed.Y);
                            double y2 = Math.Max(hinge.Y, closed.Y);
                            if (y1 - minY > EPS) wandList.Add(rect(minX, minY, maxX, y1));
                            if (maxY - y2 > EPS) wandList.Add(rect(minX, y2,   maxX, maxY));
                        }
                        wasCut = true;
                        break;
                    }
                }
            }
            if (!wasCut) wandList.Add(wall);
        }

        foreach (var f in root["furniture"]) {
            var c = corners[(string)f["corner"]];
            meubelPts.Add(new Point3d(c.X + (double)f["dx"], c.Y + (double)f["dy"], 0));
            int rot = f["rotation"] != null ? (int)f["rotation"] : 0;
            string ftype = (string)f["type"];
            meubelNames.Add(rot != 0 ? ftype + " (" + rot + ")" : ftype);
        }

        if (root["furnitureFlex"] != null) {
            foreach (var f in root["furnitureFlex"]) {
                meubelFlex.Add(new Polyline(readVerts(f)));
            }
        }
    }

    // ============ Procedureel ============
    double yMin = kopDwarsMin ? -KOPGEVEL_OFFSET         : 0;
    double yMax = kopDwarsMax ?  range + KOPGEVEL_OFFSET : range;

    if (kopDwarsMin) wandList.Add(rect(0, yMin, diepte, 0));
    if (kopDwarsMax) wandList.Add(rect(0, range, diepte, yMax));

    var zonePositions = new List<double> { ZONE1, ZONE2 };
    if (diepte - ZONE2 > ZONE3_MAX) {
        zonePositions.Add((ZONE2 + diepte) / 2.0);
    }
    foreach (var zx in zonePositions) {
        zoneList.Add(new Line(
            new Point3d(zx, yMin - OVERSTEEK, 0),
            new Point3d(zx, yMax + OVERSTEEK, 0)));
    }

    double hM1 = yMin - OVERSTEEK - OFF1;
    double hM2 = yMin - OVERSTEEK - OFF2;
    var splitX = new List<double> { 0.0 };
    splitX.AddRange(zonePositions);
    splitX.Add(diepte);
    for (int i = 0; i < splitX.Count - 1; i++) {
        maatList.Add(new Line(
            new Point3d(splitX[i],     hM1, 0),
            new Point3d(splitX[i + 1], hM1, 0)));
    }
    maatList.Add(new Line(new Point3d(0, hM2, 0), new Point3d(diepte, hM2, 0)));

    maatList.Add(new Line(new Point3d(-OFF1,         yMin, 0), new Point3d(-OFF1,         yMax, 0)));
    maatList.Add(new Line(new Point3d(-OFF2,         yMin, 0), new Point3d(-OFF2,         yMax, 0)));
    maatList.Add(new Line(new Point3d(diepte + OFF1, yMin, 0), new Point3d(diepte + OFF1, yMax, 0)));
    maatList.Add(new Line(new Point3d(diepte + OFF2, yMin, 0), new Point3d(diepte + OFF2, yMax, 0)));

    beukList.Add(new Line(new Point3d(-OVERSTEEK, 0,     0), new Point3d(diepte + OVERSTEEK, 0,     0)));
    beukList.Add(new Line(new Point3d(-OVERSTEEK, range, 0), new Point3d(diepte + OVERSTEEK, range, 0)));

    wanden        = wandList;
    kozijnen      = kozijnList;
    zones         = zoneList;
    binnenwanden  = binnenList;
    deurbladen    = bladList;
    deurbogen     = boogList;
    kamers        = kamerList;
    maatlijnen    = maatList;
    beuklijnen    = beukList;
    meubelpunten  = meubelPts;
    meubelnamen   = meubelNames;
    meubelvlakken = meubelFlex;
}
}
# ---------- end c_script_11 ----------
panel = Panel(c_script_10)
tag = TextTag3D(Location=c_script_11.meubelpunten, Text=c_script_11.meubelnamen, Size=Slider(100, range=0..100), Justification=7)
panel_2 = Panel("G:\.shortcut-targets-by-id\0B_5OHUJey33oYTdLNlZCQU5jRWs\ROOT SUSTAINER HOMES\R&D\V6 Rowhouse\04_DRAWINGS\01_CAD & RHINO\Grasshopper Script\Furniture\")
block_instance = BlockInstance(<block instance referenced from the Rhino model>)
explode = ExplodeObject(Object=block_instance, Recursive=False)
txt = Text(block_instance)
object = ModelObject(Object=explode)  # -> Object, Geometry, Name, Layer, Visibility, Display, Drafting, Render
c_script_12 = CSharpScript(b=block_instance, n=txt)  # -> Labels; inputs b: list of InstanceReferenceGeometry, n: list of String; same code as c_script
tmatch = MatchText(Text=object.Geometry, Pattern="*hat*", Case=False)
concat = Concatenate(FragmentA=panel_2, FragmentB=c_script_12, FragmentC=".svg")
dispatch = Dispatch(List=object.Name, DispatchPattern=tmatch)  # -> ListA, ListB
dispatch_2 = Dispatch(List=object.Layer, DispatchPattern=tmatch)  # -> ListA, ListB
dispatch_3 = Dispatch(List=object.Geometry, DispatchPattern=tmatch)  # -> ListA, ListB
data = Data(dispatch_3.ListA)
hatch = ModelHatch(Hatch=dispatch_3.ListA)  # -> Hatch, Boundary, Plane, HatchPattern, BasePoint, Rotation, Scale, ShowBoundary, Background, FillStyle
boundary = BoundarySurfaces(Edges=hatch.Boundary)
mesh = Mesh(boundary)
c_script_13 = CSharpScript(curves=flatten(dispatch_3.ListB), hatches=flatten(mesh), path=concat, run=Button())  # -> out, Result; inputs curves: list of Curve, hatches: list of Mesh, curveColors: list of Color, path: String, run: Boolean
# ---------- c_script_13: C# ----------
// Grasshopper Script Instance
#region Usings
using System;
using System.Linq;
using System.Collections;
using System.Collections.Generic;
using System.Drawing;

using Rhino;
using Rhino.Geometry;

using Grasshopper;
using Grasshopper.Kernel;
using Grasshopper.Kernel.Data;
using Grasshopper.Kernel.Types;
#endregion

public class Script_Instance : GH_ScriptInstance
{
    private void RunScript(
		List<Curve> curves,
		List<Mesh> hatches,
		List<Color> curveColors,
		string path,
		bool run,
		ref object Result)
{
    if (!run || string.IsNullOrEmpty(path))
    {
        Result = "Set run to true and provide a valid path.";
        return;
    }

    var svgContent = new System.Text.StringBuilder();

    // 1. Get Bounding Box for ViewBox
    BoundingBox bbox = BoundingBox.Empty;
    if (curves != null) foreach (var crv in curves) bbox.Union(crv.GetBoundingBox(true));
    if (hatches != null) foreach (var msh in hatches) bbox.Union(msh.GetBoundingBox(true));

    if (!bbox.IsValid) return;

    Vector3d span = bbox.Diagonal;
    bbox.Inflate(span.X * 0.1, span.Y * 0.1, 0.0);
    Vector3d inflatedSpan = bbox.Diagonal;

    svgContent.AppendLine($"<svg xmlns=\"http://www.w3.org/2000/svg\" viewBox=\"{bbox.Min.X} {-bbox.Max.Y} {inflatedSpan.X} {inflatedSpan.Y}\" width=\"{inflatedSpan.X}\" height=\"{inflatedSpan.Y}\">");

    // 2. Export Hatches as white background
    if (hatches != null)
    {
        foreach (var msh in hatches)
        {
            AppendMeshToSvg(svgContent, msh, Color.White);
        }
    }

    // 3. Export Curves with specific logic
    // Default brown: #766750
    string brownHex = "#766750";
    string greyHex = "#808080";

    if (curves != null)
    {
        for (int i = 0; i < curves.Count; i++)
        {
            Color col = (curveColors != null && i < curveColors.Count) ? curveColors[i] : Color.Black;
            
            string currentHex;
            double strokeWidth;

            if (IsGrey(col))
            {
                currentHex = greyHex;
                strokeWidth = 2.0; // Thicker for input
            }
            else
            {
                currentHex = brownHex;
                strokeWidth = 0.5;
            }

            AppendCurveToSvg(svgContent, curves[i], currentHex, strokeWidth);
        }
    }

    svgContent.AppendLine("</svg>");

    try
    {
        System.IO.File.WriteAllText(path, svgContent.ToString());
        Result = $"Successfully exported to {path}";
    }
    catch (Exception ex)
    {
        Result = $"Error: {ex.Message}";
    }
}

private void AppendCurveToSvg(System.Text.StringBuilder sb, Curve curve, string hex, double weight)
{
    if (curve == null) return;
    
    Polyline p;
    if (!curve.TryGetPolyline(out p))
    {
        var nc = curve.ToPolyline(0, 0, 0.1, 0, 0, 0, 0, 0, true);
        if (nc == null) return;
        p = nc.ToPolyline();
    }

    sb.Append($"<polyline points=\"");
    foreach (var pt in p)
    {
        sb.Append($"{pt.X},{-pt.Y} ");
    }
    sb.AppendLine($"\" fill=\"none\" stroke=\"{hex}\" stroke-width=\"{weight}\" />");
}

private void AppendMeshToSvg(System.Text.StringBuilder sb, Mesh mesh, Color col)
{
    if (mesh == null) return;
    string hex = $"#{col.R:X2}{col.G:X2}{col.B:X2}";

    foreach (var face in mesh.Faces)
    {
        sb.Append("<polygon points=\"");
        sb.Append($"{mesh.Vertices[face.A].X},{-mesh.Vertices[face.A].Y} ");
        sb.Append($"{mesh.Vertices[face.B].X},{-mesh.Vertices[face.B].Y} ");
        sb.Append($"{mesh.Vertices[face.C].X},{-mesh.Vertices[face.C].Y} ");
        if (face.IsQuad) sb.Append($"{mesh.Vertices[face.D].X},{-mesh.Vertices[face.D].Y} ");
        sb.AppendLine($"\" fill=\"{hex}\" stroke=\"none\" />");
    }
}

private bool IsGrey(Color c) => Math.Abs(c.R - 128) < 15 && Math.Abs(c.G - 128) < 15 && Math.Abs(c.B - 128) < 15;
}
# ---------- end c_script_13 ----------

# ==== cluster Cluster
T = ClusterInput()
graft = GraftTree(Tree=T, IncludeEmptyLists=True, IncludeNullItems=True)
block_instance = BlockInstance(graft)
clean = CleanTree(RemoveNulls=True, RemoveInvalid=True, RemoveEmpty=True, Tree=block_instance)
txt = Text(clean)
explode = ExplodeObject(Object=clean, Recursive=False)
c_script = CSharpScript(b=clean, n=txt)  # -> Labels; inputs b: list of InstanceReferenceGeometry, n: list of String
#   port b: Casts source data to object
# ---------- c_script: C# ----------
// Grasshopper Script Instance
#region Usings
using System;
using System.Linq;
using System.Collections;
using System.Collections.Generic;
using System.Drawing;

using Rhino;
using Rhino.Geometry;

using Grasshopper;
using Grasshopper.Kernel;
using Grasshopper.Kernel.Data;
using Grasshopper.Kernel.Types;
#endregion

public class Script_Instance : GH_ScriptInstance
{
private void RunScript(
		List<InstanceReferenceGeometry> b,
		List<string> n,
		ref object Labels)
{
  const double tol = 1e-9;

  List<string> labels = new List<string>();
  Labels = labels;

  if (b == null)
    return;

  for (int i = 0; i < b.Count; i++)
  {
    InstanceReferenceGeometry inst = b[i];
    if (inst == null)
      continue;

    string name = "Block";
    if (n != null && i < n.Count && !string.IsNullOrWhiteSpace(n[i]))
      name = CleanBlockName(n[i]);

    Plane pl = Plane.WorldXY;
    pl.Transform(inst.Xform);

    if (!pl.IsValid)
      continue;

    double angle = Vector3d.VectorAngle(Vector3d.XAxis, pl.XAxis, Plane.WorldXY);
    double deg = NormalizeAngle(RhinoMath.ToDegrees(angle));

    int rounded = (int)Math.Round(deg);

    labels.Add($"{name} ({rounded})");
  }
}

private string CleanBlockName(string s)
{
  if (string.IsNullOrWhiteSpace(s))
    return "Block";

  s = s.Trim();

  int a = s.LastIndexOf('(');
  int b = s.LastIndexOf(')');

  if (a >= 0 && b > a)
  {
    string inside = s.Substring(a + 1, b - a - 1).Trim();

    if (!string.IsNullOrWhiteSpace(inside))
      return inside;
  }

  return s;
}

private double NormalizeAngle(double deg)
{
  deg = deg % 360.0;

  if (deg < 0.0)
    deg += 360.0;

  if (Math.Abs(deg - 360.0) < 1e-9)
    deg = 0.0;

  return deg;
}
}
# ---------- end c_script ----------
tmatch = MatchText(Text=explode, Pattern="*input*", Case=False)
cull = CullPattern(List=explode, CullPattern=tmatch)
panel = Panel(explode)
object = ModelObject(Object=cull, Name=c_script, Layer=<geometry referenced from the Rhino model>)  # -> Object, Geometry, Name, Layer, Visibility, Display, Drafting, Render
shift = ShiftPaths(Data=object.Object, Offset=-1)
merge = Merge(Data1=shift, Data2=graft)
pt = ConstructPoint(XCoordinate=0, YCoordinate=Slider(16, range=0..100000), ZCoordinate=0)
item = ListItem(List=merge, Index=0, Wrap=True)
groundfloor = Data(flatten(item))
object_2 = ModelObject(Object=groundfloor)  # -> Object, Geometry, Name, Layer
brec = BoundingRectangle(Geometry=object_2.Geometry, Plane=PlaneXY(0, 0, 0), Axis=0, Slide=0, Union=True)  # -> Bounding, DimensionX, DimensionY
explode_2 = Explode(Curve=brec.Bounding, Recursive=True)  # -> Segments, Vertices
ts4 = TreeStructure4(ID=object_2.Layer, GenericData=object_2.Name)  # -> ID, Planes
ts4_2 = TreeStructure4(ID=object_2.Layer, GenericData=object_2.Geometry)  # -> ID, Planes
item_2 = ListItem(List=explode_2.Vertices, Index=0, Wrap=True)
vec2pt = Vector2Pt(PointA=item_2, PointB=pt, Unitize=False)  # -> Vector, Length
move = Move(Geometry=ts4_2.Planes, Motion=vec2pt.Vector)  # -> Geometry, Transform
long = LongestList(ListA=ts4.ID, ListB=ts4.Planes, PaddingMode=2)  # -> ListA, ListB
A = ClusterOutput(long.ListA)
P = ClusterOutput(ts4.Planes)
G = ClusterOutput(move.Geometry)
